# Grasshopper definition sdTF_spec_example.ghx (Grasshopper 1.0.7)
# plug-ins: ShapeDiver, BitmapComponent

sddb = ShapeDiverDatabase({AppDescription="", AppName="unnamed", DocumentName="unnamed", InputGroups="{}", OutputGroups="{\"b6e49261-0eef-4616-a1f2-df06c53e3d7f\":{\"name\":\"ShapeDiver Out\",\"guid\":\"b6e49261-0eef-4616-a1f2-df06c53e3d7f\",\"index\":0,\"params\":[\"71b842f2-fca1-4ca2-861f-0c2d2f3b3c6c\",\"67021693-b26c-420b-9c07-3be263d00cd4\",\"995efe05-950c-4c07-8dbf-37b427d743fc\"],\"indexFloor\":0,\"indexCeiling\":0}}", SdID=""})
panel = Panel("""Name
Color
Layer
Preview""")
bmp = Bitmap(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)
construct_attributes = ConstructAttributes(Keys=panel, Values=["Mesh sphere", ColourSwatch(SwatchColor=RGB(126, 156, 255)), "Some layer", bmp])
num = Number(graft([0, 1, 1, 2, 3, 5, 8, 13, 21, 34, 55, 89, 144]))
num_2 = Number(graft([1, 2, 3, 5, 7, 11, 13, 17, 19, 23, 27]))
mesh = Mesh(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)
mesh_2 = Mesh(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)
inject_shapediver_attributes = InjectShapeDiverAttributes(Object=mesh, Attributes=construct_attributes)
entwine = Entwine(Branch00=num, Branch01=num_2, FlattenInputs=True)
numbers = Number(entwine)
mesh_3 = Mesh(graft([inject_shapediver_attributes, mesh_2]))
images = Bitmap(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)
panel_2 = Panel(mesh_3)
panel_3 = Panel(images)
shapediver_out = ShapeDiverOutput(Out1=mesh_3, Out4=images, Numbers=numbers)
